# Grasshopper definition daylight_guided_furniture_layout.gh (Grasshopper 1.0.7)

bed = Curve(<curve referenced from the Rhino model>)
lounge = Curve(<curve referenced from the Rhino model>)
desk = Curve(<curve referenced from the Rhino model>)
room = Curve(<curve referenced from the Rhino model>)
explode = Explode(Curve=bed, Recursive=True)  # -> reparameterize(Segments), Vertices
explode_2 = Explode(Curve=lounge, Recursive=True)  # -> reparameterize(Segments), Vertices
explode_3 = Explode(Curve=desk, Recursive=True)  # -> reparameterize(Segments), Vertices
explode_4 = Explode(Curve=room, Recursive=True)  # -> Segments, Vertices
hframe = HorizontalFrame(Curve=explode.Segments, Parameter="0.5")
hframe_2 = HorizontalFrame(Curve=explode_2.Segments, Parameter="0.5")
hframe_3 = HorizontalFrame(Curve=explode_3.Segments, Parameter="0.5")
divlength = DivideLength(Curve=explode_4.Segments, Length="36")  # -> Points, Tangents, Parameters
hframe_4 = HorizontalFrame(Curve=graft(explode_4.Segments), Parameter=divlength.Parameters)  # -> flatten(Frame)
cull_i = CullIndex(List=hframe, Indices="1", Wrap=True)  # -> graft(List)
item = ListItem(List=hframe_2, Index="3", Wrap=True)
cull_i_2 = CullIndex(List=hframe_3, Indices="0", Wrap=True)
orient = Orient(Geometry=bed, Source=cull_i, Target=hframe_4)  # -> Geometry, Transform
bang = ExplodeTree(Data=orient.Geometry)  # -> _0000, _0001, _0002
item_2 = ListItem(List=bang._0002, Index=Slider(6, range=0..26), Wrap=True)
